# Grasshopper definition AddTwoNumbers.gh (Grasshopper 1.0.7)

num1 = GetNumber(AtLeast=1, AtMost=1, Maximum=1.797693135e+308, Minimum=-1.797693135e+308, TreeAccess=False)
num2 = GetNumber(AtLeast=1, AtMost=1, Maximum=1.797693135e+308, Minimum=-1.797693135e+308, TreeAccess=False)
addition = Addition(A=num1, B=num2)
context_print = ContextPrint(Text=addition)
