# Grasshopper definition AntHill_Building Frame.gh (Grasshopper 1.0.7)
# plug-ins: Karamba3D, Swiftlet, TT Toolbox

x_bay_span = Slider(20, range=5..40)
story_height = Slider(10, range=5..40)
y_bay_span = Slider(20, range=5..40)
geo = Geometry(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)
xbaysize = GetNumber(x_bay_span, AtLeast=1, AtMost=1, Maximum=1.797693135e+308, Minimum=-1.797693135e+308, TreeAccess=False)
ybaysize = GetNumber(y_bay_span, AtLeast=1, AtMost=1, Maximum=1.797693135e+308, Minimum=-1.797693135e+308, TreeAccess=False)
storyheight = GetNumber(story_height, AtLeast=1, AtMost=1, Maximum=1.797693135e+308, Minimum=-1.797693135e+308, TreeAccess=False)
c_script = CSharpScript(x=xbaysize, y=ybaysize)  # -> out, A; inputs x: Double, y: Double
# ---------- c_script: C# ----------
    double value = x;
    if (x > y)
    {
      value = x;
    }
    else if (y > x)
    {
      value = y;
    }
    else if (x == y)
    {
      value = x;
    }
    
    A = value;
# ---------- end c_script ----------
bbox = BoundingBox(Content=geo, Plane=PlaneXY(0, 0, 0))  # -> Box, Box_2
debox = DeconstructBox(Box=bbox.Box)  # -> Plane, X, Y, Z

# ---- group: X Bay Points
dedomain = DeconstructDomain(Domain=debox.X)  # -> Start, End
subtraction = Subtraction(A=dedomain.End, B=dedomain.Start)
division = Division(A=subtraction, B=xbaysize)
abs = Absolute(Value=division)
round = Round(Number=abs)  # -> Nearest, Floor, Ceiling
division_2 = Division(A=subtraction, B=round.Nearest)
expression = Expression(x=round.Nearest, Expression="x+1")
series = Series(Start=dedomain.Start, Step=division_2, Count=expression)

# ---- group: Y Bay Points
dedomain_2 = DeconstructDomain(Domain=debox.Y)  # -> Start, End
subtraction_2 = Subtraction(A=dedomain_2.End, B=dedomain_2.Start)
division_3 = Division(A=subtraction_2, B=ybaysize)
abs_2 = Absolute(Value=division_3)
round_2 = Round(Number=abs_2)  # -> Nearest, Floor, Ceiling
division_4 = Division(A=subtraction_2, B=round_2.Nearest)
expression_2 = Expression(x=round_2.Nearest, Expression="x+1")
series_2 = Series(Start=dedomain_2.Start, Step=division_4, Count=expression_2)

dedomain_3 = DeconstructDomain(Domain=debox.Z)  # -> Start, End
subtraction_3 = Subtraction(A=dedomain_3.End, B=dedomain_3.Start)
division_5 = Division(A=subtraction_3, B=storyheight)
abs_3 = Absolute(Value=division_5)
round_3 = Round(Number=abs_3)  # -> Nearest, Floor, Ceiling
division_6 = Division(A=subtraction_3, B=round_3.Nearest)
expression_3 = Expression(x=round_3.Nearest, Expression="x+1")
series_3 = Series(Start=dedomain_3.Start, Step=division_6, Count=expression_3)
pt = ConstructPoint(XCoordinate=0, YCoordinate=0, ZCoordinate=series_3)  # -> simplify(Point)

# ----
lng = ListLength(List=series)
lng_2 = ListLength(List=series_2)
xy = XYPlane(Origin=pt)
mesh = MeshBrep(
    Brep=geo,
    Settings={GridMaxCount=0, GridMinCount=16, JaggedSeams=False, MaxEdgeLength=0, MinEdgeLength=0.0001, MinTolerance=0, Refine=True, RefineAngle=0, RelativeTolerance=0.65, SimplePlanes=True, Tolerance=0})
split = SplitList(List=xy, Index="1")  # -> ListA, ListB
sec = MeshPlane(Mesh=mesh, Plane=split.ListB)
sec_2 = MeshPlane(Mesh=mesh, Plane=xy)
sdivide = DivideSurface(Surface=graft(sec_2), UCount=lng, VCount=lng_2)  # -> simplify(Points), Normals, Parameters
sdivide_2 = DivideSurface(Surface=graft(sec), UCount=lng, VCount=lng_2)  # -> simplify(Points), Normals, Parameters
path_mapper = PathMapper(sdivide_2.Points, source="{A;B}(i)", target="{A;i}(B)")
pt_2 = Point(path_mapper)
pt_3 = Point(sdivide.Points)
pline = PolyLine(Vertices=sdivide_2.Points, Closed=False)
pline_2 = PolyLine(Vertices=pt_2, Closed=False)
pshift = ShiftPaths(Data=pt_3, Offset=-1)
explode = Explode(Curve=pline, Recursive=True)  # -> Segments, Vertices
flip = FlipMatrix(Data=pshift)
explode_2 = Explode(Curve=pline_2, Recursive=True)  # -> Segments, Vertices
pline_3 = PolyLine(Vertices=flip, Closed=False)
explode_3 = Explode(Curve=pline_3, Recursive=True)  # -> flatten(Segments), Vertices
cullduplines = RemoveDuplicateLines(InputLines=explode_3.Segments, Tolerance=0.001)  # -> OutputLines, FirstLineIndexes

# ---- group: Column Points
pt_4 = Point(sdivide.Points)

# ---- group: Beams X
crv = Curve(explode.Segments)

# ---- group: Beams Y
crv_2 = Curve(explode_2.Segments)

# ---- group: Slabs Brep
brep = Brep(sec)

# ---- group: Columns
crv_3 = Curve(cullduplines.OutputLines)

# ----
crv_4 = Curve(flatten([crv_2, crv]))

# ---- group: Slab Heights
series_4 = Series(Start=Slider(10, range=0..100), Step=Slider(8, range=0..100), Count="9")
entwine = Entwine(Branch00=series_4, Branch01="90", FlattenInputs=True)  # -> flatten(Result)

# ----
# Framing Options
matselect = MaterialSelectionKaramba3D(menu=[dropdown(1), dropdown(8)])
panel = Panel("""10
20
30
40
50
60
70
80
120
180""")
concat = Concatenate(FragmentA="col", FragmentB=panel)
cross_section = CrossSectionKaramba3D(
    FamilyNameOfCrossSection="DefaultCroSec",
    NameOfCrossSection=concat,
    Material=matselect,
    Height_cm=panel,
    UpperFlangeWidth_cm=panel,
    LowerFlangeWidth_cm=panel,
    UpperFlangeThickness_cm="1",
    LowerFlangeThickness_cm="1",
    SidewallsThickness_cm="1",
    FilletRadius_cm=0.6,
    mode="Box")
crosecselect = CrossSectionSelectorKaramba3D(CrossSections=cross_section)  # -> CrossSection, Info

# ----
# Framing Options
matselect_2 = MaterialSelectionKaramba3D(menu=[dropdown(1), dropdown(8)])
panel_2 = Panel("""10
20
30
40
50
60
70
80
120
180""")
concat_2 = Concatenate(FragmentA="col", FragmentB=panel_2)
cross_section_2 = CrossSectionKaramba3D(
    FamilyNameOfCrossSection="DefaultCroSec",
    NameOfCrossSection=concat_2,
    Material=matselect_2,
    Height_cm=panel_2,
    UpperFlangeWidth_cm=panel_2,
    LowerFlangeWidth_cm=panel_2,
    UpperFlangeThickness_cm="1",
    LowerFlangeThickness_cm="1",
    SidewallsThickness_cm="1",
    FilletRadius_cm=0.6,
    mode="Box")
crosecselect_2 = CrossSectionSelectorKaramba3D(CrossSections=cross_section_2)  # -> CrossSection, Info

matselect_3 = MaterialSelectionKaramba3D(menu=[dropdown(7), dropdown(16)])
cross_section_3 = CrossSectionKaramba3D(FamilyNameOfCrossSection="DefaultCroSec", Material=matselect_3, Height_cm=entwine, mode="Shell - Const")  # -> flatten(CrossSection)
crosecselect_3 = CrossSectionSelectorKaramba3D(CrossSections=cross_section_3)  # -> CrossSection, Info
pt_5 = Point(flatten(pt_4))
supp = SupportKaramba3D(PosInd=pt_5, menu=[buttons(on, on, on, on, on, on)])
linetobeam = LineToBeamKaramba3D(
    Line=flatten(crv_4),
    CrossSection=crosecselect_2.CrossSection,
    New=True,
    Remove=True,
    LimitDistance_m=0.005,
    Bending=True,
    SetBucklingLength=True,
    ToPolylineMaxAngle=0.03,
    ToPolylineTolerance=0.01,
    ToPolylineMinEdgeLength=0.25)  # -> Element, Points, Info
linetobeam_2 = LineToBeamKaramba3D(
    Line=flatten(crv_3),
    CrossSection=crosecselect.CrossSection,
    New=True,
    Remove=True,
    LimitDistance_m=0.005,
    Bending=True,
    SetBucklingLength=True,
    ToPolylineMaxAngle=0.03,
    ToPolylineTolerance=0.01,
    ToPolylineMinEdgeLength=0.25)  # -> Element, Points, Info
mesh_breps = MeshBrepsKaramba3D(
    Brep=brep,
    InclusionPoints=linetobeam_2.Points,
    MeshResolution="5",
    EdgeRefinementFactor=0.67,
    PointReduction=False,
    SmoothingStepSize=0,
    SmoothingIterations=5)  # -> Mesh, Info

# ----
# Loading
panel_3 = Panel("{0,0,-1.0}")
loads = LoadsKaramba3D(Vector=panel_3, LCase="dead", mode="Gravity")
loads_2 = LoadsKaramba3D(
    Vector="{0,0,-2.0}",
    Mesh=mesh_breps.Mesh,
    LCase="dead",
    mode="MeshLoad -Const.",
    menu=[buttons(on, off, off), buttons(off, on)])

meshtoshell = MeshToShellKaramba3D(Mesh=mesh_breps.Mesh, CrossSection=crosecselect_3.CrossSection, LimitDistance_m=0.005)  # -> Element, Points, Info
assemble = AssembleModelKaramba3D(
    Elem=flatten([linetobeam.Element, linetobeam_2.Element, meshtoshell.Element]),
    Support=supp,
    Load=flatten([loads_2, loads]),
    LimitDistance_m=0.005)  # -> Model, Info, Mass_kg, CenterOfGravity, LoadCaseNames
division_7 = Division(A=c_script.A, B="250")
multiplication = Multiplication(A=division_7, B="100")
Z = UnitZ(Factor=expr("x*-1", multiplication))
opticrosec = OptimizeCrossSectionKaramba3D(
    Model=assemble.Model,
    CrossSections=flatten([cross_section, cross_section_3]),
    MaximumUtilization=Slider(1, range=0..1),
    MaximumDisplacement_cm=Z,
    UltimateLimitStateIterations="10",
    DisplacementIterations="10",
    NumberOfSamplePoints=3,
    ElasticDesign=True,
    GammaM0=1,
    GammaM1=1.1,
    SwayFrame=True)  # -> ModelWithOptimizedCrossSections, Info, Mass_kg, MaximumDisplacement_cm, ElasticEnergy_kNm
modelview = ModelViewKaramba3D(Model=opticrosec.ModelWithOptimizedCrossSections, ResultFactors=1, ResultCase=-1)  # -> Model, DeformedMesh, DeformedAxes, DeformedModel
shellview = ShellViewKaramba3D(Model=modelview.Model, IndexOfLayer=0)  # -> Model, MeshesOfRenderedShells, LegendColors, LegendTags
beamview = BeamViewKaramba3D(Model=modelview.Model)  # -> Model, MeshesOfRenderedBeams, DeformedBeamAxes, LegendColors, LegendTags
legend = Legend(Colour=shellview.LegendColors, Tags=shellview.LegendTags, LegendType=1)
legend_2 = Legend(Colour=beamview.LegendColors, Tags=beamview.LegendTags, LegendType=1)
disassemble = DisassembleModelKaramba3D(Model=modelview.Model)  # -> Model, Point, Beam, Shell, Support, Load, Line, Mesh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
disassemble_2 = DisassembleElementKaramba3D(Element=disassemble.Beam)  # -> Element, ElementIdentifier, AxisOfElement, CrossSection, Joint, Material, LocalCoordinateSystem, ElementIsActive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
crv_5 = Curve(disassemble.Beam)
disassemble_3 = DisassembleElementKaramba3D(Element=disassemble.Shell)  # -> Element, ElementIdentifier, AxisOfElement, CrossSection, Joint, Material, LocalCoordinateSystem, ElementIsActive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
devec = DeconstructVector(Vector=crv_5)  # -> flatten(XComponent), YComponent, ZComponent
disassemble_4 = DisassembleCrossSectionKaramba3D(CroSec=disassemble_2.CrossSection)  # -> CrossSection, FamilyNameOfCrossSection, TypeNameOfCrossSection, ElemIdentifiers, Color, Material, LocalEccentricity_cm, Heights_cm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
disassemble_5 = DisassembleCrossSectionKaramba3D(CroSec=disassemble_3.CrossSection)  # -> CrossSection, FamilyNameOfCrossSection, TypeNameOfCrossSection, ElemIdentifiers, Color, Material, LocalEccentricity_cm, Heights_cm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
num = Number(devec.ZComponent)
num_2 = Number("0")
num_3 = Number(devec.ZComponent)
num_4 = Number("1")
mindex = MemberIndex(Set=num_3, Member=num_4)  # -> Index, Count
mindex_2 = MemberIndex(Set=num, Member=num_2)  # -> Index, Count
item = ListItem(List=disassemble_4.Area_cm2, Index=mindex_2.Index, Wrap=True)
item_2 = ListItem(List=disassemble_4.Area_cm2, Index=mindex.Index, Wrap=True)
data = Data(item)
data_2 = Data(item_2)
expression_4 = Expression(x=data, Expression="x*0.000001")
expression_5 = Expression(x=data_2, Expression="x*0.000001")
len = Length(Curve=crv_4)
len_2 = Length(Curve=crv_3)
area = Area(Geometry=brep)  # -> flatten(Area), Centroid
debrep = DeconstructBrep(Brep=brep)  # -> Faces, Edges, Vertices
multiplication_2 = Multiplication(A=len, B=expression_4)
multiplication_3 = Multiplication(A="0.1", B=area.Area)
pt_6 = Point(simplify(debrep.Vertices))
multiplication_4 = Multiplication(A=len_2, B=expression_5)
flip_2 = FlipMatrix(Data=pt_6)
end = EndPoints(Curve=crv_4)  # -> Start, End
multiplication_5 = Multiplication(A=multiplication_2, B="137.16")
multiplication_6 = Multiplication(A=multiplication_3, B="308")
end_2 = EndPoints(Curve=crv_3)  # -> Start, End
multiplication_7 = Multiplication(A=multiplication_4, B="137.16")
bang = ExplodeTree(Data=flip_2)  # -> Branch0, Branch1, Branch2, Branch3

# ---- group: End Points
pt_7 = Point(end.End)

# ---- group: Carbon Emission
data_3 = Data(multiplication_5)

# ---- group: CarbonSystem
ma = MassAddition(Input=data_3)  # -> Result, PartialResults

# ---- group: Start Points
pt_8 = Point(end.Start)

# ---- group: Carbon Emission
data_4 = Data(multiplication_7)

# ---- group: CarbonSystem
ma_2 = MassAddition(Input=data_4)  # -> Result, PartialResults

# ---- group: Start Points
pt_9 = Point(end_2.Start)

# ---- group: End Points
pt_10 = Point(end_2.End)

# ----
ma_3 = MassAddition(Input=multiplication_6)  # -> Result, PartialResults
data_5 = Data(multiplication_6)
pt_11 = Point(bang.Branch0)
pt_12 = Point(bang.Branch1)
pt_13 = Point(bang.Branch2)
pt_14 = Point(bang.Branch3)
txt = Text(flatten(pt_8))
txt_2 = Text(flatten(pt_7))
txt_3 = Text(flatten(data_3))
txt_4 = Text(flatten(pt_14))
txt_5 = Text(flatten(pt_13))
txt_6 = Text(flatten(pt_12))
txt_7 = Text(flatten(data_5))
txt_8 = Text(flatten(pt_11))
txt_9 = Text(flatten(pt_9))
txt_10 = Text(flatten(pt_10))
txt_11 = Text(flatten(data_4))
cjv = CreateJSONValue(Value=txt_3)
cjv_2 = CreateJSONValue(Value=txt)
cjv_3 = CreateJSONValue(Value=txt_2)
cjv_4 = CreateJSONValue(Value=txt_11)
cjv_5 = CreateJSONValue(Value=txt_9)
cjv_6 = CreateJSONValue(Value=txt_10)
cjv_7 = CreateJSONValue(Value=txt_4)
cjv_8 = CreateJSONValue(Value=txt_5)
cjv_9 = CreateJSONValue(Value=txt_6)
cjv_10 = CreateJSONValue(Value=txt_7)
cjv_11 = CreateJSONValue(Value=txt_8)
panel_4 = Panel("""CarbonEmission
PointStart
PointEnd""")
panel_5 = Panel("""CarbonEmission
PointStart
PointEnd""")
merge = Merge(Data1=graft(cjv), Data2=graft(cjv_2), Data3=graft(cjv_3))
merge_2 = Merge(Data1=graft(cjv_4), Data2=graft(cjv_5), Data3=graft(cjv_6))
panel_6 = Panel("""CarbonEmission
Point1
Point2
Point3
Point4""")
merge_3 = Merge(Data1=graft(cjv_10), Data2=graft(cjv_11), Data3=graft(cjv_9), Data4=graft(cjv_8), Data5=graft(cjv_7))
txt_12 = Text(ma.Result)
cjo = CreateJSONObject(Keys=panel_4, Values=merge)  # -> flatten(JObject)
txt_13 = Text(ma_2.Result)
txt_14 = Text(ma_3.Result)
cjo_2 = CreateJSONObject(Keys=panel_5, Values=merge_2)  # -> flatten(JObject)
cjv_12 = CreateJSONValue(Value=txt_12)
cjv_13 = CreateJSONValue(Value=txt_13)
cjv_14 = CreateJSONValue(Value=txt_14)
cjo_3 = CreateJSONObject(Keys=panel_6, Values=merge_3)  # -> flatten(JObject)
cja = CreateJSONArray(JTokens=cjo)
cjo_4 = CreateJSONObject(Keys="beamSystemCO2", Values=cjv_12)
cja_2 = CreateJSONArray(JTokens=cjo_2)
cjo_5 = CreateJSONObject(Keys="colomnSystemCO2", Values=cjv_13)
cjo_6 = CreateJSONObject(Keys="SlabSystemCO2", Values=cjv_14)
cja_3 = CreateJSONArray(JTokens=cjo_3)
merge_4 = Merge(Data1=cjo_4, Data2=cja)  # -> flatten(Result)
merge_5 = Merge(Data1=cjo_5, Data2=cja_2)  # -> flatten(Result)
addition = Addition(A=ma.Result, B=ma_2.Result, C=ma_3.Result)
merge_6 = Merge(Data1=cjo_6, Data2=cja_3)  # -> flatten(Result)
cja_4 = CreateJSONArray(JTokens=merge_4)
cja_5 = CreateJSONArray(JTokens=merge_5)
txt_15 = Text(addition)
cja_6 = CreateJSONArray(JTokens=merge_6)
cjv_15 = CreateJSONValue(Value=txt_15)
cjo_7 = CreateJSONObject(Keys="BeamSystem", Values=cja_4)
cjo_8 = CreateJSONObject(Keys="ColumnSystem", Values=cja_5)
cjo_9 = CreateJSONObject(Keys="SlabSystem", Values=cja_6)
cjo_10 = CreateJSONObject(Keys="TotalCO2", Values=cjv_15)
merge_7 = Merge(Data1=cjo_7, Data2=cjo_8, Data3=cjo_9, Data4=cjo_10)  # -> flatten(Result)
cja_7 = CreateJSONArray(JTokens=merge_7)
cjo_11 = CreateJSONObject(Keys="StructuralFrame", Values=cja_7)
sjt = StringifyJSONToken(JToken=cjo_11)
context_print = ContextPrint(Text=sjt)
panel_7 = Panel(sjt)
