# Grasshopper definition BOX_Building Frame.gh (Grasshopper 1.0.7)
# plug-ins: Karamba3D, Swiftlet

x_bay_span = Slider(20, range=5..40)
story_height = Slider(10, range=5..40)
y_bay_span = Slider(20, range=5..40)
geo = Geometry(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)
xbaysize = GetNumber(x_bay_span, AtLeast=1, AtMost=1, Maximum=1.797693135e+308, Minimum=-1.797693135e+308, TreeAccess=False)
ybaysize = GetNumber(y_bay_span, AtLeast=1, AtMost=1, Maximum=1.797693135e+308, Minimum=-1.797693135e+308, TreeAccess=False)
storyheight = GetNumber(story_height, AtLeast=1, AtMost=1, Maximum=1.797693135e+308, Minimum=-1.797693135e+308, TreeAccess=False)
bbox = BoundingBox(Content=geo, Plane=PlaneXY(0, 0, 0))  # -> Box, Box_2
debox = DeconstructBox(Box=bbox.Box)  # -> Plane, X, Y, Z

# ---- group: X Bay Points
dedomain = DeconstructDomain(Domain=debox.X)  # -> Start, End
subtraction = Subtraction(A=dedomain.End, B=dedomain.Start)
division = Division(A=subtraction, B=xbaysize)
abs = Absolute(Value=division)
round = Round(Number=abs)  # -> Nearest, Floor, Ceiling
division_2 = Division(A=subtraction, B=round.Nearest)
expression = Expression(x=round.Nearest, Expression="x+1")
series = Series(Start=dedomain.Start, Step=division_2, Count=expression)

# ---- group: Y Bay Points
dedomain_2 = DeconstructDomain(Domain=debox.Y)  # -> Start, End
subtraction_2 = Subtraction(A=dedomain_2.End, B=dedomain_2.Start)
division_3 = Division(A=subtraction_2, B=ybaysize)
abs_2 = Absolute(Value=division_3)
round_2 = Round(Number=abs_2)  # -> Nearest, Floor, Ceiling
division_4 = Division(A=subtraction_2, B=round_2.Nearest)
expression_2 = Expression(x=round_2.Nearest, Expression="x+1")
series_2 = Series(Start=dedomain_2.Start, Step=division_4, Count=expression_2)

dedomain_3 = DeconstructDomain(Domain=debox.Z)  # -> Start, End
subtraction_3 = Subtraction(A=dedomain_3.End, B=dedomain_3.Start)
division_5 = Division(A=subtraction_3, B=storyheight)
abs_3 = Absolute(Value=division_5)
round_3 = Round(Number=abs_3)  # -> Nearest, Floor, Ceiling
division_6 = Division(A=subtraction_3, B=round_3.Nearest)
expression_3 = Expression(x=round_3.Nearest, Expression="x+1")
series_3 = Series(Start=dedomain_3.Start, Step=division_6, Count=expression_3)
pt = ConstructPoint(XCoordinate=0, YCoordinate=0, ZCoordinate=series_3)  # -> simplify(Point)

# ----
lng = ListLength(List=series)
lng_2 = ListLength(List=series_2)
split = SplitList(List=pt, Index="1")  # -> ListA, ListB
mesh = MeshBrep(
    Brep=geo,
    Settings={GridMaxCount=0, GridMinCount=16, JaggedSeams=False, MaxEdgeLength=0, MinEdgeLength=0.0001, MinTolerance=0, Refine=True, RefineAngle=0, RelativeTolerance=0.65, SimplePlanes=True, Tolerance=0})
xy = XYPlane(Origin=split.ListB)
sec = MeshPlane(Mesh=mesh, Plane=xy)
sdivide = DivideSurface(Surface=graft(sec), UCount=lng, VCount=lng_2)  # -> simplify(Points), Normals, Parameters
path_mapper = PathMapper(sdivide.Points, source="{A;B}(i)", target="{A;i}(B)")
pt_2 = Point(path_mapper)
pt_3 = Point(sdivide.Points)
pline = PolyLine(Vertices=sdivide.Points, Closed=False)
pline_2 = PolyLine(Vertices=pt_2, Closed=False)
pshift = ShiftPaths(Data=pt_3, Offset=-1)
explode = Explode(Curve=pline, Recursive=True)  # -> Segments, Vertices
flip = FlipMatrix(Data=pshift)
explode_2 = Explode(Curve=pline_2, Recursive=True)  # -> Segments, Vertices
pline_3 = PolyLine(Vertices=flip, Closed=False)
explode_3 = Explode(Curve=pline_3, Recursive=True)  # -> Segments, Vertices

# ---- group: Column Points
pt_4 = Point(sdivide.Points)

# ---- group: Beams X
crv = Curve(explode.Segments)

# ---- group: Columns
crv_2 = Curve(explode_3.Segments)

# ---- group: Beams Y
crv_3 = Curve(explode_2.Segments)

# ---- group: Slabs Brep
brep = Brep(sec)

# ----
crv_4 = Curve(flatten([crv_3, crv]))

# ---- group: Slab Heights
series_4 = Series(Start=Slider(10, range=0..100), Step=Slider(8, range=0..100), Count="9")
entwine = Entwine(Branch00=series_4, Branch01="90", FlattenInputs=True)  # -> flatten(Result)

# ----
# Framing Options
matselect = MaterialSelectionKaramba3D(menu=[dropdown(1), dropdown(8)])
panel = Panel("""10
20
30
40
50
60
70
80
120
180""")
concat = Concatenate(FragmentA="col", FragmentB=panel)
cross_section = CrossSectionKaramba3D(
    FamilyNameOfCrossSection="DefaultCroSec",
    NameOfCrossSection=concat,
    Material=matselect,
    Height_cm=panel,
    UpperFlangeWidth_cm=panel,
    LowerFlangeWidth_cm=panel,
    UpperFlangeThickness_cm="1",
    LowerFlangeThickness_cm="1",
    SidewallsThickness_cm="1",
    FilletRadius_cm=0.6,
    mode="Box")
crosecselect = CrossSectionSelectorKaramba3D(CrossSections=cross_section)  # -> CrossSection, Info

# ----
# Framing Options
matselect_2 = MaterialSelectionKaramba3D(menu=[dropdown(1), dropdown(8)])
panel_2 = Panel("""10
20
30
40
50
60
70
80
120
180""")
concat_2 = Concatenate(FragmentA="col", FragmentB=panel_2)
cross_section_2 = CrossSectionKaramba3D(
    FamilyNameOfCrossSection="DefaultCroSec",
    NameOfCrossSection=concat_2,
    Material=matselect_2,
    Height_cm=panel_2,
    UpperFlangeWidth_cm=panel_2,
    LowerFlangeWidth_cm=panel_2,
    UpperFlangeThickness_cm="1",
    LowerFlangeThickness_cm="1",
    SidewallsThickness_cm="1",
    FilletRadius_cm=0.6,
    mode="Box")
crosecselect_2 = CrossSectionSelectorKaramba3D(CrossSections=cross_section_2)  # -> CrossSection, Info

matselect_3 = MaterialSelectionKaramba3D(menu=[dropdown(7), dropdown(16)])
cross_section_3 = CrossSectionKaramba3D(FamilyNameOfCrossSection="DefaultCroSec", Material=matselect_3, Height_cm=entwine, mode="Shell - Const")  # -> flatten(CrossSection)
crosecselect_3 = CrossSectionSelectorKaramba3D(CrossSections=cross_section_3)  # -> CrossSection, Info
pt_5 = Point(flatten(pt_4))
supp = SupportKaramba3D(PosInd=pt_5, menu=[buttons(on, on, on, on, on, on)])
linetobeam = LineToBeamKaramba3D(
    Line=flatten(crv_4),
    CrossSection=crosecselect_2.CrossSection,
    New=True,
    Remove=True,
    LimitDistance_m=0.005,
    Bending=True,
    SetBucklingLength=True,
    ToPolylineMaxAngle=0.03,
    ToPolylineTolerance=0.01,
    ToPolylineMinEdgeLength=0.25)  # -> Element, Points, Info
linetobeam_2 = LineToBeamKaramba3D(
    Line=flatten(crv_2),
    CrossSection=crosecselect.CrossSection,
    New=True,
    Remove=True,
    LimitDistance_m=0.005,
    Bending=True,
    SetBucklingLength=True,
    ToPolylineMaxAngle=0.03,
    ToPolylineTolerance=0.01,
    ToPolylineMinEdgeLength=0.25)  # -> Element, Points, Info
mesh_breps = MeshBrepsKaramba3D(
    Brep=brep,
    InclusionPoints=linetobeam_2.Points,
    MeshResolution="5",
    EdgeRefinementFactor=0.67,
    PointReduction=False,
    SmoothingStepSize=0,
    SmoothingIterations=5)  # -> Mesh, Info

# ----
# Loading
panel_3 = Panel("{0,0,-1.0}")
loads = LoadsKaramba3D(Vector=panel_3, LCase="dead", mode="Gravity")
loads_2 = LoadsKaramba3D(
    Vector="{0,0,-2.0}",
    Mesh=mesh_breps.Mesh,
    LCase="dead",
    mode="MeshLoad -Const.",
    menu=[buttons(on, off, off), buttons(off, on)])

meshtoshell = MeshToShellKaramba3D(Mesh=mesh_breps.Mesh, CrossSection=crosecselect_3.CrossSection, LimitDistance_m=0.005)  # -> Element, Points, Info
assemble = AssembleModelKaramba3D(
    Elem=flatten([linetobeam.Element, linetobeam_2.Element, meshtoshell.Element]),
    Support=supp,
    Load=flatten([loads_2, loads]),
    LimitDistance_m=0.005)  # -> Model, Info, Mass_kg, CenterOfGravity, LoadCaseNames

# ---- group: Max Bay Length
number_slider = Slider(9, range=0..10)

# ----
division_7 = Division(A=number_slider, B="250")
multiplication = Multiplication(A=division_7, B="100")
Z = UnitZ(Factor=expr("x*-1", multiplication))
opticrosec = OptimizeCrossSectionKaramba3D(
    Model=assemble.Model,
    CrossSections=flatten([cross_section, cross_section_3]),
    MaximumUtilization=Slider(1, range=0..1),
    MaximumDisplacement_cm=Z,
    UltimateLimitStateIterations="10",
    DisplacementIterations="10",
    NumberOfSamplePoints=3,
    ElasticDesign=True,
    GammaM0=1,
    GammaM1=1.1,
    SwayFrame=True)  # -> ModelWithOptimizedCrossSections, Info, Mass_kg, MaximumDisplacement_cm, ElasticEnergy_kNm
modelview = ModelViewKaramba3D(Model=opticrosec.ModelWithOptimizedCrossSections, ResultFactors=1, ResultCase=-1)  # -> Model, DeformedMesh, DeformedAxes, DeformedModel
shellview = ShellViewKaramba3D(Model=modelview.Model, IndexOfLayer=0)  # -> Model, MeshesOfRenderedShells, LegendColors, LegendTags
beamview = BeamViewKaramba3D(Model=modelview.Model)  # -> Model, MeshesOfRenderedBeams, DeformedBeamAxes, LegendColors, LegendTags
legend = Legend(Colour=shellview.LegendColors, Tags=shellview.LegendTags, LegendType=1)
legend_2 = Legend(Colour=beamview.LegendColors, Tags=beamview.LegendTags, LegendType=1)
disassemble = DisassembleModelKaramba3D(Model=modelview.Model)  # -> Model, Point, Beam, Shell, Support, Load, Line, Mesh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
disassemble_2 = DisassembleElementKaramba3D(Element=disassemble.Beam)  # -> Element, ElementIdentifier, AxisOfElement, CrossSection, Joint, Material, LocalCoordinateSystem, ElementIsActive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
disassemble_3 = DisassembleCrossSectionKaramba3D(CroSec=disassemble_2.CrossSection)  # -> CrossSection, FamilyNameOfCrossSection, TypeNameOfCrossSection, ElemIdentifiers, Color, Material, LocalEccentricity_cm, Heights_cm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
crv_5 = Curve(disassemble.Beam)
num = Number("0.1")
cjv = CreateJSONValue(Value=num)
cjv_2 = CreateJSONValue(Value="#ff0000")
devec = DeconstructVector(Vector=crv_5)  # -> flatten(XComponent), YComponent, ZComponent
panel_4 = Panel("""color
opacity""")
merge = Merge(Data1=cjv_2, Data2=cjv)
num_2 = Number(devec.XComponent)
num_3 = Number("0")
num_4 = Number(devec.XComponent)
num_5 = Number("1")
cjv_3 = CreateJSONValue(Value="defaultOff")
cjv_4 = CreateJSONValue(Value="Color By Element")
cjo = CreateJSONObject(Keys=panel_4, Values=merge)
cjv_5 = CreateJSONValue(Value="Something")
mindex = MemberIndex(Set=num_4, Member=num_5)  # -> Index, Count
mindex_2 = MemberIndex(Set=num_2, Member=num_3)  # -> Index, Count
item = ListItem(List=disassemble_3.Area_cm2, Index=mindex_2.Index, Wrap=True)
panel_5 = Panel("""title
attributes
passiveMaterial
visualizationMode""")
data = Data(item)
merge_2 = Merge(Data1=cjv_4, Data2=cjv_5, Data3=cjo, Data4=cjv_3)
expression_4 = Expression(x=data, Expression="x*0.000001")
len = Length(Curve=crv_4)
cjo_2 = CreateJSONObject(Keys=panel_5, Values=merge_2)
multiplication_2 = Multiplication(A=len, B=expression_4)
multiplication_3 = Multiplication(A=multiplication_2, B="137.16")
end = EndPoints(Curve=crv_4)  # -> Start, End
cjv_6 = CreateJSONValue(Value="attributeVisualization")
merge_3 = Merge(Data1=cjo_2)
pt_6 = Point(end.End)

# ---- group: Carbon Emission
data_2 = Data(multiplication_3)

# ----
pt_7 = Point(end.Start)
merge_4 = Merge(Data1=cjv_6, Data2=merge_3)
panel_6 = Panel("""type
props""")
txt = Text(flatten(pt_7))
txt_2 = Text(flatten(pt_6))
txt_3 = Text(flatten(data_2))
cjo_3 = CreateJSONObject(Keys=panel_6, Values=merge_4)
sjt = StringifyJSONToken(JToken=cjo_3)
cjv_7 = CreateJSONValue(Value=txt_3)
cjv_8 = CreateJSONValue(Value=txt)
cjv_9 = CreateJSONValue(Value=txt_2)
panel_7 = Panel("""CarbonEmmision
PointStart
PointEnd""")
merge_5 = Merge(Data1=graft(cjv_7), Data2=graft(cjv_8), Data3=graft(cjv_9))
panel_8 = Panel(sjt)
cjo_4 = CreateJSONObject(Keys=panel_7, Values=merge_5)  # -> flatten(JObject)
cja = CreateJSONArray(JTokens=cjo_4)
cjo_5 = CreateJSONObject(Keys="BeamSystem", Values=cja)
merge_6 = Merge(Data1=cjo_5)
cjo_6 = CreateJSONObject(Keys="StructuralFrame", Values=merge_6)
sjt_2 = StringifyJSONToken(JToken=cjo_6)
panel_9 = Panel(sjt_2)
context_print = ContextPrint(Text=sjt_2)
